# Grasshopper definition Ladybugexample03.gh (Grasshopper 1.0.7)

# ----
# Import Location from EPW File
panel = Panel("http://climate.onebuilding.org/WMO_Region_4_North_and_Central_America/USA_United_States_of_America/WI_Wisconsin/USA_WI_Madison-Dane.County.Rgnl.AP-Truax.Field.726410_TMY3.zip")
downloadepw = LBDownloadWeather(weather_URL=panel)  # -> epw_file, stat_file, ddy_file; plug-in component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
importloc = LBImportLocation(epw_file=downloadepw.epw_file)  # -> location; plug-in component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

# ----
# Analysis Period for
# Summer Solstice
panel_2 = Panel("6")
analysisperiod = LBAnalysisPeriod(start_month=panel_2, start_day="21", start_hour="8", end_month=panel_2, end_day="21", end_hour="17", timestep="4")  # -> period, hoys, dates; plug-in component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

mesh_analysis_skin = GetInteger(Slider(0, range=0..2), AtLeast=1, AtMost=1, Maximum=2147483647, Minimum=-2147483648)
shadow_analysis = GetBoolean(Toggle(True), AtLeast=1, AtMost=1, FalseValue="False", TrueValue="True")

# ----
# Create Sunpath
panel_3 = Panel("20")
sunpath = LBSunPath(north=panel_3, location=importloc, hoys=analysisperiod.hoys, scale=Slider(5, range=0..10))  # -> report, vectors, altitudes, azimuths, hoys, sun_pts, analemma, daily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; plug-in component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

mesh = Mesh(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)

# ---- group: Run Me!
toggle = BooleanToggle(True)

# ----
# Run Direct Sun Study
panel_4 = Panel("0.1")
directsunhours = LBDirectSunHours(vectors=flatten(sunpath.vectors), timestep="4", geometry=flatten(mesh), grid_size="1", offset_dist=panel_4, run=toggle)  # -> report, points, results, mesh, legend, title, int_mtx; plug-in component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

bounds = Bounds(Numbers=directsunhours.results)
remap_numbers = RemapNumbers(Value=directsunhours.results, Source=bounds, Target=Domain(0.1, 1))  # -> Mapped, Clipped
faceb = FaceBoundaries(Mesh=mesh)
pcen = PolygonCenter(Polyline=faceb)  # -> CenterV, CenterE, CenterA
scale = Scale(Geometry=faceb, Center=pcen.CenterV, Factor=remap_numbers.Mapped)  # -> Geometry, Transform
explode = Explode(Curve=faceb, Recursive=True)  # -> Segments, Vertices
explode_2 = Explode(Curve=scale.Geometry, Recursive=True)  # -> Segments, Vertices
end = EndPoints(Curve=explode.Segments)  # -> Start, End
end_2 = EndPoints(Curve=explode_2.Segments)  # -> Start, End
merge = Merge(
    Data1=simplify(graft(end.Start)),
    Data2=simplify(graft(end.End)),
    Data3=simplify(graft(end_2.End)),
    Data4=simplify(graft(end_2.Start)))
conmesh = ConstructMesh(Vertices=merge, Faces={A=0, B=1, C=2, D=3})

# ---- group: SHADOW ANALAYSIS
pt = ConstructPoint(XCoordinate=0, YCoordinate=0, ZCoordinate=0)
stream_gate = StreamGate(Stream=mesh, Gate=shadow_analysis)  # -> Target0, Target1
vec2pt = Vector2Pt(PointA=sunpath.sun_pts, PointB=pt, Unitize=False)  # -> Vector, Length
mshadow = MeshShadow(Mesh=stream_gate.Target1, Light=vec2pt.Vector, Plane=PlaneXY(0, 0, 0))  # -> flatten(Outlines)

# ----
mesh_join = MeshJoin(Meshes=flatten(conmesh))
mesh_sphere = MeshSphere(Base=sunpath.sun_pts, Radius=10, UCount=10, VCount=20)
series = Series(Start=0, Step=1, Count=Slider(7, range=0..10))
stream_filter = StreamFilter(Gate=mesh_analysis_skin, Stream0=mesh, Stream1=directsunhours.mesh, Stream2=mesh_join)
list_item = ListItem(List=sunpath.compass, Index=series, Wrap=True)
mesh_colours = MeshColours(Mesh=mesh_sphere, Colours=ColourSwatch(SwatchColor=RGB(255, 226, 5)))
mesh_edges = MeshEdges(Mesh=mesh)  # -> NakedEdges, InteriorEdges, NonManifoldEdges

# ---- group: RH_OUT:mesh02
mesh_2 = Mesh(stream_filter)

# ---- group: RH_OUT:shadow
curve = Curve(mshadow)

# ---- group: RH_OUT:sunmesh
mesh_3 = Mesh(mesh_colours)

# ----
curve_2 = Curve(flatten([list_item, sunpath.analemma, sunpath.daily, mesh_edges.NakedEdges, mesh_edges.InteriorEdges]))
rebuild_curve = RebuildCurve(Curve=curve_2, Degree=1, Count=Slider(50, range=0..100), Tangents=False)

# ---- group: RH_OUT:crvs
curve_3 = Curve(flatten(rebuild_curve))
