# Grasshopper definition Ring_V03a.gh (Grasshopper 1.0.7)

# BM  //  RING DESIGN APP
# Data Management
inputs = Data("INPUTS")
xz_plane = XZPlane(Origin=Point(0, 0, 0))
number_slider = Slider(11, range=9..15)
process = Data("PROCESS")
circle = Circle(Plane=xz_plane, Radius=Slider(10, range=0..10))
outputs = Data("OUTPUTS")
perp_frames = PerpFrames(Curve=circle, Count=number_slider, Align=True)  # -> Frames, Parameters
range = Range(Domain="360", Steps=number_slider)
cull_index = CullIndex(List=range, Indices="-1", Wrap=True)
radians = Radians(Degrees=cull_index)
multiplication = Multiplication(A=radians, B=Slider(3, range=0..10))
rotate = Rotate(Geometry=perp_frames.Frames, Angle=multiplication, Plane=perp_frames.Frames)  # -> Geometry, Transform
girth = GetNumber(
    Slider(3, range=3..7),
    AtLeast=3,
    AtMost=7,
    Maximum=1.797693135e+308,
    Minimum=-1.797693135e+308,
    Prompt="Specifies the thickness of the ring")
twist_intensity = GetNumber(
    Slider(4, range=4..10),
    AtLeast=4,
    AtMost=10,
    Maximum=1.797693135e+308,
    Minimum=-1.797693135e+308,
    Prompt="Adjusts the amount of twisting on the ring")
polygon = Polygon(Plane=rotate.Geometry, Radius=girth, Segments=twist_intensity, FilletRadius=Slider(0.72, range=0..1))  # -> Polygon, Length
curve = Curve(simplify(graft(polygon.Polygon)))
radians_2 = Radians(Degrees=Slider(15, range=0..360))
area = Area(Geometry=polygon.Polygon)  # -> Area, Centroid
pt = ConstructPoint(XCoordinate=0, YCoordinate=0, ZCoordinate=Slider(0.93, range=-1..1))
panel = Panel(curve)
pull_point = PullPoint(Point=area.Centroid, Geometry=pt, ClosestOnly=True)  # -> ClosestPoint, Distance
rotate_3d = Rotate3D(Geometry=curve, Angle=radians_2, Center=Point(0, 0, 0), Axis="{0,1,0}")  # -> Geometry, Transform
area_2 = Area(Geometry=rotate_3d.Geometry)  # -> Area, Centroid
bounds = Bounds(Numbers=pull_point.Distance)
scale = Scale(Geometry=rotate_3d.Geometry, Center=area_2.Centroid, Factor=0.5)  # -> simplify(graft(Geometry)), Transform
construct_domain = ConstructDomain(DomainStart=Slider(1, range=0..1), DomainEnd=Slider(0.2, range=0..1))
remap_numbers = RemapNumbers(Value=pull_point.Distance, Source=bounds, Target=construct_domain)  # -> Mapped, Clipped
merge = Merge(Data1=curve, Data2=scale.Geometry)
scale_2 = Scale(Geometry=polygon.Polygon, Center=area.Centroid, Factor=remap_numbers.Mapped)  # -> Geometry, Transform
panel_2 = Panel(merge)
smooth_edges = GetBoolean(Toggle(False), AtLeast=1, AtMost=1, FalseValue="False", Prompt="Smoothes the sharp edges", TrueValue="True")
no_twist = GetBoolean(
    Toggle(False),
    AtLeast=1,
    AtMost=1,
    FalseValue="False",
    Prompt="Specifies wether twist would be included",
    TrueValue="True")
# v01 22.03.09
loft_options = LoftOptions(Closed=True, Adjust=no_twist, Rebuild=0, Refit=smooth_edges, Type=Toggle(True))
loft = Loft(Curves=scale_2.Geometry, Options=loft_options)
loft_2 = Loft(Curves=flatten(merge), Options=loft_options)
loft_3 = Loft(Curves=polygon.Polygon, Options=loft_options)
Y = UnitY(Factor=Slider(5, range=0..10))
panel_3 = Panel("{0,3,0}")
ring_type = GetNumber(Slider(2, range=0..2), AtLeast=0, AtMost=2, Maximum=2, Minimum=0)
filter = StreamFilter(Gate=ring_type, Stream0=loft_2, Stream1=loft_3, Stream2=loft)
double_ring = GetBoolean(Toggle(True), AtLeast=1, AtMost=1, FalseValue="False", TrueValue="True")
move = Move(Geometry=filter, Motion=Y)  # -> Geometry, Transform
filter_2 = StreamFilter(Gate=double_ring, Stream0=filter, Stream1=[filter, move.Geometry])

# ---- group: RH_OUT:Ring
mesh = Mesh(filter_2)

# ----
preview = CustomPreview(Geometry=mesh, Material=ColourSwatch(SwatchColor=RGB(168, 160, 160)))
