# Grasshopper definition geo_upload.gh (Grasshopper 1.0.7)

geo = Geometry([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])
lines = GetLine(geo, AtLeast=1, AtMost=1, Realtime=True)
end = EndPoints(Curve=lines)  # -> Start, End
merge = Merge(Data1=end.Start, Data2=end.End)
del = DelaunayMesh(Points=merge, Plane=PlaneXY(0, 0, 0))

# ---- group: RH_OUT:lines
crv = Curve(lines)

# ---- group: RH_OUT:mesh
rh_out_mesh = Mesh(del)
