# Grasshopper definition path_test.gh (Grasshopper 1.0.7)

dimension = GetInteger(AtLeast=1, AtMost=1, Maximum=2147483647, Minimum=-2147483648)
python = GhPythonScript(relPath="../examples/")  # -> out, a
# ---------- python: Python ----------
import os
import Grasshopper

directory = os.getcwd()
#print directory



form = Grasshopper.Instances.DocumentEditor;
docServer = Grasshopper.Instances.DocumentServer
path = docServer[0].FilePath;

if path == None:
    ghfilepath = "Unnamed"
else:
    ghfilepath = path

#print ghfilepath

dirname = os.path.dirname(ghfilepath)

print dirname
if dirname != os.getcwd():
    dirname = os.chdir(dirname) 

abs = os.path.abspath(relPath)
print os.path.exists(abs)

a = dirname
# ---------- end python ----------
python_2 = GhPythonScript(relPath="../examples/")  # -> out, a
# ---------- python_2: Python ----------
import os
import Grasshopper

directory = os.getcwd()

a = os.path.abspath("x")


form = Grasshopper.Instances.DocumentEditor;
docServer = Grasshopper.Instances.DocumentServer
path = docServer[0].FilePath;

if path == None:
    form = "Unnamed"
else:
    form1 = path

dirname = os.path.dirname(form1)
print form1
print type(form1)

os.chdir(dirname) 
print os.getcwd()


a = form
# ---------- end python_2 ----------
panel = Panel(python_2.a)
